% Simulink data dictionary SiDrivetrainDD.sldd

N = [-4.7 6.75 6.75 3.75 3.25 2.75 2.25 1.5 1 0.75]
Ndiff = 3
Re = 0.3
b_axle = Simulink.Parameter(10)
b_driveshaft = Simulink.Parameter(10)
k_axle = Simulink.Parameter(5000)
k_driveshaft = Simulink.Parameter(1000)
wc_shaft = Simulink.Parameter(50)